# Dynamo graph 4D simulation CJ dynamo v4.dyn (Dynamo 2.12.1.8246)

# group: Select All Element (Auto filter)
select_model_elements = DSModelElementsSelection()  # 1 picked in the model; graph input
getCategory = Element.GetCategory(element=select_model_elements)

# group: Group Structure Framing
string_from_object = FromObject(obj=getCategory)
code_block = CodeBlock { "Structural Framing"; }
contains = String.Contains(string=string_from_object, searchFor=code_block)
filterByBoolMask = List.FilterByBoolMask(list=select_model_elements, mask=contains)
location = StructuralFraming.Location(structuralFraming=filterByBoolMask.in)

# group: Model Selection line Allow more than one
line = DSModelElementsSelection()  # 1 picked in the model; graph input
curves = Element.Curves(element=line)

code_block_2 = CodeBlock { 140000; -20000; }
code_block_3 = CodeBlock { 0; 1; }

# group: Group Slab
string_from_object_2 = FromObject(obj=getCategory)
code_block_4 = CodeBlock { "Floor"; }
contains_2 = String.Contains(string=string_from_object_2, searchFor=code_block_4)
filterByBoolMask_2 = List.FilterByBoolMask(list=select_model_elements, mask=contains_2)

# group: Check face
faces = Element.Faces(element=filterByBoolMask_2.in)
normalAtParameter = Surface.NormalAtParameter(surface=faces)
string_from_object_3 = FromObject(obj=normalAtParameter)
code_block_5 = CodeBlock { "Z = 1.000"; }
contains_3 = String.Contains(string=string_from_object_3, searchFor=code_block_5)
filterByBoolMask_3 = List.FilterByBoolMask(list=faces, mask=contains_3)

# group: Level Checker
categories = Categories("OST_FloorsSurfacePattern")
all_elements_of_category = ElementsOfCategory(Category=categories)
string_from_object_4 = FromObject(obj=all_elements_of_category)
code_block_6 = CodeBlock { "Work Plane"; }
getParameterValueByName = Element.GetParameterValueByName(element=line, parameterName=code_block_6)
string_from_object_5 = FromObject(obj=getParameterValueByName)
code_block_7 = CodeBlock { "Level : "; }
split = String.Split(string=string_from_object_5, separator0=code_block_7)
uniqueItems = List.UniqueItems(list=split)
contains_4 = String.Contains(string=string_from_object_4, searchFor=uniqueItems@L1)
flatten = List.Flatten(list=contains_4)
filterByBoolMask_4 = List.FilterByBoolMask(list=all_elements_of_category, mask=flatten)
indexOf = List.IndexOf(list=all_elements_of_category, element=filterByBoolMask_4.out@L1)
code_block_8 = CodeBlock(a=indexOf) { a+1; }
getItemAtIndex = List.GetItemAtIndex(list=all_elements_of_category, index=indexOf)
elevation = Level.Elevation(level=getItemAtIndex)
elevation_2 = Level.Elevation(level=filterByBoolMask_4.in)
code_block_9 = CodeBlock { -1000; }
code_block_10 = CodeBlock(a=elevation, b=elevation_2, C=code_block_9) { a-b-C; }

# group: Blade prepare
join = List.Join()  # unwired: list0, list1
ZAxis = Vector.ZAxis()
translate = Geometry.Translate(geometry=curves, direction=ZAxis, distance=code_block_2.out0, lacing=Longest)
translate_2 = Geometry.Translate(geometry=curves, direction=ZAxis, distance=code_block_2.out1, lacing=Longest)
combine = List.Combine(comb=join, list1=translate, list2=translate_2)
byLoft = Surface.ByLoft(crossSections=combine)
code_block_11 = CodeBlock { 0; }
code_block_12 = CodeBlock(a=code_block_11, b=code_block_9) { a-b; }

# group: Split Beam
doesIntersect = Geometry.DoesIntersect(geometry=location, other=byLoft, lacing=CrossProduct)
allFalse = List.AllFalse(list=doesIntersect, lacing=Longest)
filterByBoolMask_5 = List.FilterByBoolMask(list=location, mask=allFalse)
split_2 = Geometry.Split(geometry=filterByBoolMask_5.out, other=byLoft@@L1)
count = List.Count(list=split_2@@L2)
string_from_object_6 = FromObject(obj=count)
code_block_13 = CodeBlock { "2"; }
contains_5 = String.Contains(string=string_from_object_6, searchFor=code_block_13)
filterByBoolMask_6 = List.FilterByBoolMask(list=split_2, mask=contains_5)
filterByBoolMask_7 = List.FilterByBoolMask(list=filterByBoolMask.in, mask=allFalse)

getItemAtIndex_2 = List.GetItemAtIndex(list=filterByBoolMask_6.in@@L2, index=code_block_3.out1)
flatten_2 = List.Flatten(list=getItemAtIndex_2@L1, lacing=Longest)
elementType = Element.ElementType(element=filterByBoolMask_7.out)
flatten_3 = List.Flatten(list=elementType@L1, lacing=Longest)

# group: Rebuild Beam
code_block_14 = CodeBlock { "Reference Level"; }
getParameterValueByName_2 = Element.GetParameterValueByName(element=filterByBoolMask_7.out, parameterName=code_block_14)

flatten_4 = List.Flatten(list=getParameterValueByName_2@L1, lacing=Longest)

# group (continued): Rebuild Beam
beamByCurve = StructuralFraming.BeamByCurve(curve=flatten_2@L2, level=flatten_4, structuralFramingType=flatten_3, lacing=Longest)

# group: Split slab
flatten_5 = List.Flatten(list=filterByBoolMask_3.in)
doesIntersect_2 = Geometry.DoesIntersect(geometry=flatten_5, other=byLoft, lacing=CrossProduct)
allFalse_2 = List.AllFalse(list=doesIntersect_2, lacing=Longest)
filterByBoolMask_8 = List.FilterByBoolMask(list=flatten_5, mask=allFalse_2)
split_3 = Geometry.Split(geometry=filterByBoolMask_8.out, other=byLoft@L2, lacing=CrossProduct)

# group: Rebuild Slab
count_2 = List.Count(list=split_3@@L2)
string_from_object_7 = FromObject(obj=count_2)
code_block_15 = CodeBlock { "2"; }
contains_6 = String.Contains(string=string_from_object_7, searchFor=code_block_15)
filterByBoolMask_9 = List.FilterByBoolMask(list=split_3, mask=contains_6)
perimeterCurves = Surface.PerimeterCurves(surface=filterByBoolMask_9.in)
filterByBoolMask_10 = List.FilterByBoolMask(list=filterByBoolMask_2.in, mask=allFalse_2)
elementType_2 = Element.ElementType(element=filterByBoolMask_10.out)
code_block_16 = CodeBlock { "Level"; }
getParameterValueByName_3 = Element.GetParameterValueByName(element=filterByBoolMask_10.out, parameterName=code_block_16)
byOutlineTypeAndLevel = Floor.ByOutlineTypeAndLevel(outlineCurves=perimeterCurves, floorType=elementType_2, level=getParameterValueByName_3)

# group: Group Wall
string_from_object_8 = FromObject(obj=getCategory)
code_block_17 = CodeBlock { "Wall"; }
contains_7 = String.Contains(string=string_from_object_8, searchFor=code_block_17)
filterByBoolMask_11 = List.FilterByBoolMask(list=select_model_elements, mask=contains_7)

getLocation = Element.GetLocation(element=filterByBoolMask_11.in)
split_4 = Geometry.Split(geometry=getLocation@@L2, other=byLoft, lacing=Longest)
count_3 = List.Count(list=split_4@@L2, lacing=Longest)
boolean = BoolSelector(true)
boolean_2 = BoolSelector(false)
formula = Formula("if(a=2,x,y)", a=count_3, x=boolean, y=boolean_2)
filterByBoolMask_12 = List.FilterByBoolMask(list=split_4@@L3, mask=formula, lacing=Longest)
flatten_6 = List.Flatten(list=filterByBoolMask_12.in@@L2, lacing=Shortest)
code_block_18 = CodeBlock { 0; 1; }
getItemAtIndex_3 = List.GetItemAtIndex(list=flatten_6@@L2, index=code_block_18.out0)
flatten_7 = List.Flatten(list=getItemAtIndex_3@L1, lacing=Longest)
filterByBoolMask_13 = List.FilterByBoolMask(list=filterByBoolMask_11.in@@L2, mask=formula@L2, lacing=Longest)
code_block_19 = CodeBlock { ["Base Constraint","Base Offset","Top Constraint","Unconnected Height"]; }
getParameterValueByName_4 = Element.GetParameterValueByName(element=filterByBoolMask_13.in, parameterName=code_block_19, lacing=CrossProduct)
code_block_20 = CodeBlock { 0; 1; 2; 3; }
getItemAtIndex_4 = List.GetItemAtIndex(list=getParameterValueByName_4, index=code_block_20.out3, lacing=CrossProduct)
flatten_8 = List.Flatten(list=getItemAtIndex_4@L1, lacing=Longest)
getItemAtIndex_5 = List.GetItemAtIndex(list=getParameterValueByName_4, index=code_block_20.out0, lacing=CrossProduct)
flatten_9 = List.Flatten(list=getItemAtIndex_5@L1, lacing=Longest)
elementType_3 = Element.ElementType(element=filterByBoolMask_13.in, lacing=CrossProduct)
code_block_21 = CodeBlock { 1; }
flatten_10 = List.Flatten(list=elementType_3@@L1, amount=code_block_21)
flatten_11 = List.Flatten(list=flatten_10@L2, lacing=Longest)
byCurveAndHeight = Wall.ByCurveAndHeight(curve=flatten_7@L2, height=flatten_8, level=flatten_9, wallType=flatten_11, lacing=Longest)

# group: Wall information input
code_block_22 = CodeBlock { "Base Offset"; "Top Constraint"; "Unconnected Height"; "Top Offset"; }
getParameterValueByName_5 = Element.GetParameterValueByName(element=filterByBoolMask_13.in, parameterName=code_block_22.out1)
getParameterValueByName_6 = Element.GetParameterValueByName(element=filterByBoolMask_13.in, parameterName=code_block_22.out0)
getParameterValueByName_7 = Element.GetParameterValueByName(element=filterByBoolMask_13.in, parameterName=code_block_22.out2)
getParameterValueByName_8 = Element.GetParameterValueByName(element=filterByBoolMask_13.in, parameterName=code_block_22.out3)

flatten_12 = List.Flatten(list=getParameterValueByName_5@L1, lacing=Longest)

# group (continued): Wall information input
setParameterByName = Element.SetParameterByName(element=byCurveAndHeight, parameterName=code_block_22.out1, value=flatten_12)

# group: Delete Part
count_4 = List.Count(list=beamByCurve@L2)
code_block_23 = CodeBlock { null; }
formula_2 = Formula("if(a>0,x,y)", a=count_4, x=filterByBoolMask_7.out, y=code_block_23)
count_5 = List.Count(list=byOutlineTypeAndLevel@L2)
code_block_24 = CodeBlock { null; }
formula_3 = Formula("if(a>0,x,y)", a=count_5, x=filterByBoolMask_10.out, y=code_block_24)
count_6 = List.Count(list=setParameterByName@L2, lacing=Longest)
code_block_25 = CodeBlock { null; }
formula_4 = Formula("if(a>0,x,y)", a=count_6, x=filterByBoolMask_13.in, y=code_block_25)

flatten_13 = List.Flatten(list=formula_2)

# group (continued): Delete Part
python_script = Python(IN[0]=flatten_13)  # IronPython2
# ---------- python_script.python (19 lines) ----------
import clr

clr.AddReference("RevitServices")
import RevitServices
from RevitServices.Persistence import DocumentManager
from RevitServices.Transactions import TransactionManager

doc = DocumentManager.Instance.CurrentDBDocument

elements = UnwrapElement(IN[0])

TransactionManager.Instance.EnsureInTransaction(doc)

for e in elements:
	doc.Delete(e.Id)
	
TransactionManager.Instance.TransactionTaskDone()

OUT = "done"
# ----------------------------------------

flatten_14 = List.Flatten(list=formula_3)

# group (continued): Delete Part
python_script_2 = Python(IN[0]=flatten_14)  # IronPython2; same code as python_script

flatten_15 = List.Flatten(list=formula_4)

# group (continued): Delete Part
python_script_3 = Python(IN[0]=flatten_15)  # IronPython2; same code as python_script

# group: Slab information input
code_block_26 = CodeBlock { "Height Offset From Level"; "Structural"; }
getParameterValueByName_9 = Element.GetParameterValueByName(element=filterByBoolMask_10.out, parameterName=code_block_26.out0)
setParameterByName_2 = Element.SetParameterByName(element=byOutlineTypeAndLevel, value=getParameterValueByName_9)  # unwired: parameterName
getParameterValueByName_10 = Element.GetParameterValueByName(element=filterByBoolMask_10.out, parameterName=code_block_26.out1)
setParameterByName_3 = Element.SetParameterByName(element=byOutlineTypeAndLevel, value=getParameterValueByName_10)  # unwired: parameterName

code_block_27 = CodeBlock { "Comments"; "Split"; }
setParameterByName_4 = Element.SetParameterByName(element=beamByCurve, parameterName=code_block_27.out0, value=code_block_27.out1, lacing=Longest)
setParameterByName_5 = Element.SetParameterByName(element=byOutlineTypeAndLevel, parameterName=code_block_27.out0, value=code_block_27.out1)
filterByBoolMask_14 = List.FilterByBoolMask(list=filterByBoolMask_13.in)  # unwired: mask
getItemAtIndex_6 = List.GetItemAtIndex(list=flatten_6@@L2, index=code_block_18.out1)
flatten_16 = List.Flatten(list=getItemAtIndex_6@L1, lacing=Longest)
byCurveAndHeight_2 = Wall.ByCurveAndHeight(curve=flatten_16@L2, height=flatten_8, level=flatten_9, wallType=flatten_11, lacing=Longest)

# group: Wall information input
code_block_28 = CodeBlock { "Base Offset"; "Top Constraint"; "Unconnected Height"; "Top Offset"; }
getParameterValueByName_11 = Element.GetParameterValueByName(element=filterByBoolMask_13.in, parameterName=code_block_28.out0)
getParameterValueByName_12 = Element.GetParameterValueByName(element=filterByBoolMask_13.in, parameterName=code_block_28.out2)
getParameterValueByName_13 = Element.GetParameterValueByName(element=filterByBoolMask_13.in, parameterName=code_block_28.out3)
getParameterValueByName_14 = Element.GetParameterValueByName(element=filterByBoolMask_13.in, parameterName=code_block_28.out1)

flatten_17 = List.Flatten(list=getParameterValueByName_11@L1, lacing=Longest)

# group (continued): Wall information input
setParameterByName_6 = Element.SetParameterByName(element=byCurveAndHeight_2, parameterName=code_block_28.out0, value=flatten_17)

flatten_18 = List.Flatten(list=getParameterValueByName_12@L1, lacing=Longest)

# group (continued): Wall information input
setParameterByName_7 = Element.SetParameterByName(element=byCurveAndHeight_2, parameterName=code_block_28.out2, value=flatten_18)

flatten_19 = List.Flatten(list=getParameterValueByName_13@L1, lacing=Longest)

# group (continued): Wall information input
setParameterByName_8 = Element.SetParameterByName(element=byCurveAndHeight_2, parameterName=code_block_28.out3, value=flatten_19)

watch = Watch(filterByBoolMask_12.in)
flatten_20 = List.Flatten(list=getParameterValueByName_6@L1, lacing=Longest)

# group (continued): Wall information input
setParameterByName_9 = Element.SetParameterByName(element=byCurveAndHeight, parameterName=code_block_22.out0, value=flatten_20)

flatten_21 = List.Flatten(list=getParameterValueByName_7@L1, lacing=Longest)

# group (continued): Wall information input
setParameterByName_10 = Element.SetParameterByName(element=byCurveAndHeight, parameterName=code_block_22.out2, value=flatten_21)

flatten_22 = List.Flatten(list=getParameterValueByName_8@L1, lacing=Longest)

# group (continued): Wall information input
setParameterByName_11 = Element.SetParameterByName(element=byCurveAndHeight, parameterName=code_block_22.out3, value=flatten_22)

flatten_23 = List.Flatten(list=getParameterValueByName_14@L1, lacing=Longest)

# group (continued): Wall information input
setParameterByName_12 = Element.SetParameterByName(element=byCurveAndHeight_2, parameterName=code_block_28.out1, value=flatten_23)

getParameterValueByName_15 = Element.GetParameterValueByName(element=setParameterByName_12, parameterName=code_block_28.out1)
isNull = Object.IsNull(object=getParameterValueByName_15)
setParameterByName_13 = Element.SetParameterByName(element=byCurveAndHeight, parameterName=code_block_27.out0, value=code_block_27.out1)
setParameterByName_14 = Element.SetParameterByName(element=byCurveAndHeight_2, parameterName=code_block_27.out0, value=code_block_27.out1)
getItemAtIndex_7 = List.GetItemAtIndex(list=filterByBoolMask_6.in@@L2, index=code_block_3.out0)
flatten_24 = List.Flatten(list=getItemAtIndex_7@L1, lacing=Longest)

# group: Rebuild Beam
code_block_29 = CodeBlock { "Reference Level"; }
getParameterValueByName_16 = Element.GetParameterValueByName(element=filterByBoolMask_7.out, parameterName=code_block_29)

flatten_25 = List.Flatten(list=getParameterValueByName_16@L1, lacing=Longest)

# group (continued): Rebuild Beam
beamByCurve_2 = StructuralFraming.BeamByCurve(curve=flatten_24@L2, level=flatten_25, structuralFramingType=flatten_3, lacing=Longest)

setParameterByName_15 = Element.SetParameterByName(element=beamByCurve_2, parameterName=code_block_27.out0, value=code_block_27.out1, lacing=Longest)
code_block_30 = CodeBlock { "y Justification"; }
getParameterValueByName_17 = Element.GetParameterValueByName(element=filterByBoolMask.in, parameterName=code_block_30)
flatten_26 = List.Flatten(list=getParameterValueByName_17@L1, lacing=Longest)
setParameterByName_16 = Element.SetParameterByName(element=beamByCurve, parameterName=code_block_30, value=flatten_26)
setParameterByName_17 = Element.SetParameterByName(element=beamByCurve_2, parameterName=code_block_30, value=flatten_26)
code_block_31 = CodeBlock {  }
