# Dynamo graph Slab Split V1.dyn (Dynamo 2.5.0.7460)

# group: Select Slab
select_model_element = DSModelElementSelection()  # 1 picked in the model; graph input

faces = Element.Faces(element=select_model_element)
code_block = CodeBlock(face=faces) { face[1]; }

# group: Select all related element
select_model_elements = DSModelElementsSelection()  # 5103 picked in the model; graph input

string_from_object = FromObject(obj=select_model_elements)
string_from_object_2 = FromObject(obj=select_model_element)
contains = String.Contains(str=string_from_object, searchFor=string_from_object_2)
filterByBoolMask = List.FilterByBoolMask(list=select_model_elements, mask=contains)
solids = Element.Solids(element=filterByBoolMask.out)
flatten = List.Flatten(list=solids)
byUnion = Solid.ByUnion(solids=flatten)
bySolid = PolySurface.BySolid(solid=byUnion)
split = Geometry.Split(geometry=code_block, other=bySolid, lacing=CrossProduct)
perimeterCurves = Surface.PerimeterCurves(surface=split)
count = List.Count(list=perimeterCurves@L3)
code_block_2 = CodeBlock(a=count) { 0..a-1; }
getItemAtIndex = List.GetItemAtIndex(list=perimeterCurves@@L3, index=code_block_2)
elementType = Element.ElementType(element=select_model_element)
string = StringInput("Level")  # graph input
getParameterValueByName = Element.GetParameterValueByName(element=select_model_element, parameterName=string)
byOutlineTypeAndLevel = Floor.ByOutlineTypeAndLevel(outlineCurves=getItemAtIndex, floorType=elementType, level=getParameterValueByName)
code_block_3 = CodeBlock { a-1; }  # unwired: a
notice = CodeBlock()  # //After that, please manuel del the previous slab, for safety consideration.
